# Grasshopper definition hinge_tests.gh (Grasshopper 1.0.7)
# plug-ins: Kangaroo2 Components

mesh = Mesh(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)
hingepoints = HingePoints(Mesh=mesh)  # -> _1, _2, _3, _4
edgelengths = EdgeLengths(Mesh=mesh, LengthFactor=1, Strength=100000)
c_script = CSharpScript(
    va=hingepoints._1,
    vb=hingepoints._2,
    vc=hingepoints._3,
    vd=hingepoints._4,
    restangle=Slider(0, range=0..1),
    Reference="C:\Program Files\Rhino WIP\Plug-ins\Grasshopper\Components\KangarooSolver.dll")  # -> out, A; inputs va: Point3d, vb: Point3d, vc: Point3d, vd: Point3d, restangle: Double
# ---------- c_script: C# usings ----------
using KangarooSolver;
# ---------- c_script: C# ----------
    A = new Hinge1(va, vb, vc, vd, restangle, 1);
# ---------- c_script: C# additional code ----------
  public class Hinge1 : GoalObject
  {
    //double Strength;
    double RestAngle;

    public Hinge1(Point3d P0, Point3d P1, Point3d P2, Point3d P3, double RA, double k)
    {
      PPos = new Point3d[4] { P0, P1, P2, P3 };
      Move = new Vector3d[4];
      Weighting = new double[4]{k,k,k,k};
      // Strength = k;
      RestAngle = RA;
    }

    public override void Calculate(List<KangarooSolver.Particle> p)
    {
      Point3d P0 = p[PIndex[0]].Position;
      Point3d P1 = p[PIndex[1]].Position;
      Point3d P2 = p[PIndex[2]].Position;
      Point3d P3 = p[PIndex[3]].Position;

      Vector3d V01 = P1 - P0;
      Vector3d V02 = P2 - P0;
      Vector3d V03 = P3 - P0;
      Vector3d V21 = P1 - P2;
      Vector3d V31 = P1 - P3;

      double L01 = V01.Length;
      double invL01 = 1.0 / L01;
     
      double H0 = (V02 - V02 * invL01 * invL01 * V01 * V01).Length;
      double H1 = (V03 - V03 * invL01 * invL01 * V01 * V01).Length;
      double H = 0.5 / (H0 + H1);

      double Dot0201 = V02 * V01;
      double Dot0301 = V03 * V01;
      double Dot2101 = V21 * V01;
      double Dot3101 = V31 * V01;
      //Cot is dot over mag of cross

      //Get normals
      Vector3d Cross0 = Vector3d.CrossProduct(V02, V01);
      Vector3d Cross1 = Vector3d.CrossProduct(V01, V03);

      double CurrentAngle = Vector3d.VectorAngle(Cross0, Cross1, new Plane(P0, V01));
      if (CurrentAngle > Math.PI) { CurrentAngle = CurrentAngle - 2 * Math.PI; }
      double AngleError = CurrentAngle - RestAngle;
      double InvL = 1.0 / Cross0.Length;
      double Cot0u = Dot0201 * InvL;
      double Cot0v = Dot2101 * InvL;
      InvL = 1.0 / Cross1.Length;
      double Cot1u = Dot0301 * InvL;
      double Cot1v = Dot3101 * InvL;

      double D = AngleError * H * 0.5;
      Vector3d A = Cross0 * D;
      Move[0] = Cot0v * A;
      Move[1] = Cot0u * A;
      Move[2] = -(Cot0v + Cot0u) * A;
      A = Cross1 * D;
      Move[0] += Cot1v * A;
      Move[1] += Cot1u * A;
      Move[3] = -(Cot1v + Cot1u) * A;
      //
      //      Weighting[0] = Strength;
      //      Weighting[1] = Strength;
      //      Weighting[2] = Strength;
      //      Weighting[3] = Strength;
    }

  }
# ---------- end c_script ----------
solver = Solver(GoalObjects=[edgelengths, c_script.A], Reset=Button(), Threshold=1e-15, Tolerance=0.01, On=Toggle(True))  # -> I, V, O
